# Grasshopper definition AnalyseBrep_1.gh (Grasshopper 1.0.7)
# plug-ins: MindeskText, ViewDeformations, SurfaceSlider, StressDirectionSlider, PartitionSlider, MDSKGrasshopper, SetUniBC, ViewStresses, PreDef, LoadSlider, SetUniLoad, MeshTBrep, FEMeshTBrep, DeformationSlider, ClosestPoint

load_and_bc_toggle = BooleanToggle(False)
toggle = BooleanToggle(False)
brep = Brep(<brep referenced from the Rhino model>)
scale_def_curve = Curve(<curve referenced from the Rhino model>)
# LOAD AND BC
load_curve = Curve(<curve referenced from the Rhino model>)
# MESHING
mesh_curves = Curve([<curve referenced from the Rhino model> x3])
bc_curve = Curve(<curve referenced from the Rhino model>)
len = Length(Curve=load_curve)
surfslider = SurfaceSlider(SliderVR=load_curve, Brep=brep)  # -> Surface, Text, Size, Plane, Colors, Geometry
surfslider_2 = SurfaceSlider(SliderVR=bc_curve, Brep=brep)  # -> Surface, Text, Size, Plane, Colors, Geometry
divslider = DivisionSlider(SliderVR=mesh_curves, Brep=brep)  # -> MeshDivisionU, MeshDivisionV, MeshDivisionW, Text, Size, Plane, Colors, Geometry
debrep = DeconstructBrep(Brep=brep)  # -> Faces, Edges, Vertices
mdsk_text = VRTEXT(Text=divslider.Text, Size=divslider.Size, Plane=divslider.Plane, Color=divslider.Colors, Start=toggle)
mdsk_text_2 = VRTEXT(
    Text=surfslider_2.Text,
    Size=surfslider_2.Size,
    Plane=surfslider_2.Plane,
    Color=surfslider_2.Colors,
    Start=load_and_bc_toggle)
mdsk_text_3 = VRTEXT(Text=surfslider.Text, Size=surfslider.Size, Plane=surfslider.Plane, Color=surfslider.Colors, Start=load_and_bc_toggle)
item = ListItem(List=debrep.Faces, Index=Slider(4, range=0..6), Wrap=True)
mdsk_geometry = MDSK(Geometry=divslider.Geometry, Color=divslider.Colors, Start=toggle)
mdsk_geometry_2 = MDSK(Geometry=surfslider.Geometry, Color=surfslider.Colors, Start=load_and_bc_toggle)
mdsk_geometry_3 = MDSK(Geometry=surfslider_2.Geometry, Color=surfslider_2.Colors, Start=load_and_bc_toggle)
unibc = UniformBCComponentForFEA(
    Surface=surfslider_2.Surface,
    UCount=divslider.MeshDivisionU,
    VCount=divslider.MeshDivisionV,
    WCount=divslider.MeshDivisionW,
    Brep=brep)  # -> BCPoints, BCCones, ColoringForBCCones
crv = Curve(<curve referenced from the Rhino model>)
loadslider = LoadSlider(SliderVR=crv, Brep=brep)  # -> Load, Text, Size, Plane, Colors, Geometry
uniloads = UniformLoadComponentForFEA(
    Surface=surfslider.Surface,
    LoadVector=loadslider.Load,
    UCount=divslider.MeshDivisionU,
    VCount=divslider.MeshDivisionV,
    WCount=divslider.MeshDivisionW,
    Brep=brep)  # -> PointLoads, LoadArrows, ArrowColoring
mdsk_geometry_4 = MDSK(Geometry=unibc.BCCones, Color=unibc.ColoringForBCCones, Start=load_and_bc_toggle)
mdsk_geometry_5 = MDSK(Geometry=uniloads.LoadArrows, Color=uniloads.ArrowColoring, Start=load_and_bc_toggle)

# ---- group: Loading
mdsk_text_4 = VRTEXT(Text=loadslider.Text, Size=loadslider.Size, Plane=loadslider.Plane, Color=loadslider.Colors, Start=load_and_bc_toggle)

# ----
vec = VectorXYZ(XComponent=0, YComponent=0, ZComponent=0)  # -> Vector, Length

# ---- group: Prescrived def
item_2 = ListItem(List=debrep.Vertices, Index=Slider(0, range=0..10), Wrap=True)
predef = PreDef(Points=item_2, PrescribedDeformations=vec.Vector)

# ----
mdsk_geometry_6 = MDSK(Geometry=loadslider.Geometry, Color=loadslider.Colors, Start=load_and_bc_toggle)
defslider = DeformationSlider(SliderVR=scale_def_curve, Brep=brep)  # -> Scale, Text, Size, Plane, Colors, Geometry
brep_2 = Brep()
mdsk_text_5 = VRTEXT(Text=defslider.Text, Size=defslider.Size, Plane=defslider.Plane, Color=defslider.Colors, Start=toggle)
meshtbrep = MeshTBrep(TBrep=brep, UCount=divslider.MeshDivisionU, VCount=divslider.MeshDivisionV, WCount=divslider.MeshDivisionW)  # -> Connectivity, Nodes
closest_point = FindTheClosestPointToSphere(Sphere=brep_2, Connectivity=meshtbrep.Connectivity, Nodes=meshtbrep.Nodes)  # -> Point, Text, Plane, Colors
mdsk_geometry_7 = MDSK(Geometry=defslider.Geometry, Color=defslider.Colors, Start=toggle)
mdsk_text_6 = VRTEXT(Text=closest_point.Text, Size=1, Plane=closest_point.Plane, Color=closest_point.Colors, Start=toggle)
femeshtbrep = FiniteElementOfMeshedTBrep(
    Connectivity=meshtbrep.Connectivity,
    Nodes=meshtbrep.Nodes,
    BoundaryConditions=unibc.BCPoints,
    PointLoads=uniloads.PointLoads,
    PreDeformations=predef,
    Brep=brep)  # -> Displacement, Strain, Stress, Nodes, Text, Size, Plane, ColorT
mdsk_text_7 = VRTEXT(Text=femeshtbrep.Text, Size=femeshtbrep.Size, Plane=femeshtbrep.Plane, Color=femeshtbrep.ColorT, Start=toggle)
# DEFORMATION PREVIEW
# DEFORMATION PREVIEW
# DEFORMATION PREVIEW
viewdef = ViewDeformations(
    Connectivity=meshtbrep.Connectivity,
    PointsForBreps=meshtbrep.Nodes,
    Displacement=femeshtbrep.Displacement,
    Scaling=defslider.Scale,
    Brep=brep)  # -> BrepSolid, ColorSolid, BrepOuterEdges, ColorEdges, Text, Size, Plane, ColorT
mdsk_text_8 = VRTEXT(Text=viewdef.Text, Size=viewdef.Size, Plane=viewdef.Plane, Color=viewdef.ColorT, Start=toggle)
mdsk_geometry_8 = MDSK(Geometry=viewdef.BrepOuterEdges, Color=viewdef.ColorEdges, Start=toggle)
mdsk_geometry_9 = MDSK(Geometry=viewdef.BrepSolid, Color=viewdef.ColorSolid, Start=toggle)
panel = Panel(viewdef.Plane)

# ---- group: StressDirSlider
crv_2 = Curve(<curve referenced from the Rhino model>)

# ----
stressslider = StressDirectionSlider(SliderVR=crv_2, Brep=brep)  # -> StressDirection, Text, Size, Plane, Color, Geometry

# ---- group: StressDirSlider (continued)
mdsk_text_9 = VRTEXT(Text=stressslider.Text, Size=stressslider.Size, Plane=stressslider.Plane, Color=stressslider.Color, Start=toggle)

# ----
mdsk_geometry_10 = MDSK(Geometry=stressslider.Geometry, Color=stressslider.Color, Start=toggle)
# STRESS PREVIEW
viewstress = ViewStresses(
    Connectivity=meshtbrep.Connectivity,
    PointsForBreps=meshtbrep.Nodes,
    Stresses=femeshtbrep.Stress,
    StressDirection=stressslider.StressDirection,
    Displacement=femeshtbrep.Displacement,
    Scaling=defslider.Scale,
    Brep=brep)  # -> Solid, Color_solid, Legend, Color_legend, Text, Size, Plane, Color_T
tag = TextTag3D(Location=viewstress.Plane, Text=viewstress.Text, Size=1, Justification=7)
panel_2 = Panel(viewstress.Plane)
mdsk_geometry_11 = MDSK(Geometry=viewstress.Legend, Color=viewstress.Color_legend, Start=toggle)
mdsk_text_10 = VRTEXT(Text=viewstress.Text, Size=viewstress.Size, Plane=viewstress.Plane, Color=viewstress.Color_T, Start=toggle)
mdsk_geometry_12 = MDSK(Geometry=viewstress.Solid, Color=viewstress.Color_solid, Start=toggle)
