# Grasshopper definition CantileverTest.gh (Grasshopper 1.0.7)
# plug-ins: SolidsVR

number_slider = Slider(4, range=0..5)
number_slider_2 = Slider(5, range=0..5)
pt = ConstructPoint(XCoordinate=0, YCoordinate="1000", ZCoordinate="1000")
pt_2 = ConstructPoint(XCoordinate=0, YCoordinate=0, ZCoordinate=0)
pt_3 = ConstructPoint(XCoordinate=0, YCoordinate="1000", ZCoordinate=0)
pt_4 = ConstructPoint(XCoordinate=0, YCoordinate=0, ZCoordinate="1000")
pt_5 = ConstructPoint(XCoordinate="1000", YCoordinate=0, ZCoordinate=0)
pt_6 = ConstructPoint(XCoordinate="1000", YCoordinate="1000", ZCoordinate=0)
pt_7 = ConstructPoint(XCoordinate="1000", YCoordinate="1000", ZCoordinate="1000")
pt_8 = ConstructPoint(XCoordinate="1000", YCoordinate=0, ZCoordinate="1000")
Z = UnitZ(Factor="-10")
pt_9 = Point([pt_2, pt_5, pt_6, pt_3, pt_4, pt_8, pt_7, pt])
p2b = PointsToBrep(Points=pt_9)
debrep = DeconstructBrep(Brep=p2b)  # -> Faces, Edges, Vertices
item = ListItem(List=debrep.Faces, Index=number_slider, Wrap=True)
item_2 = ListItem(List=debrep.Faces, Index=number_slider_2, Wrap=True)
number_slider_3 = Slider(1, range=0..20)
vec = VectorXYZ(XComponent=0, YComponent=0, ZComponent=Slider(2, range=0..100))  # -> Vector, Length
vec_2 = VectorXYZ(XComponent=0, YComponent=0, ZComponent=Slider(2, range=0..100))  # -> Vector, Length
vec_3 = VectorXYZ(XComponent=0, YComponent=0, ZComponent=Slider(2, range=0..100))  # -> Vector, Length
vec_4 = VectorXYZ(XComponent=0, YComponent=0, ZComponent=Slider(2, range=0..100))  # -> Vector, Length
predef = PreDef(Points="1000,0,1000", PrescribedDeformations=vec.Vector)
predef_2 = PreDef(Points="0,1000,1000", PrescribedDeformations=vec_2.Vector)
predef_3 = PreDef(Points="0,0,1000", PrescribedDeformations=vec_3.Vector)
predef_4 = PreDef(Points="1000,1000,1000", PrescribedDeformations=vec_4.Vector)
meshcbrep = MeshCBrep(Brep=p2b, Point=pt_9, UCount=number_slider_3, VCount=number_slider_3, WCount=number_slider_3)
uniloads = UniformLoadComponentForFEA(SurfaceNumber=number_slider_2, LoadVector=Z, Mesh=meshcbrep)  # -> PointLoads, LoadArrows, ArrowColoring
unibc = UniformBCComponentForFEA(Surface=number_slider, UCount=meshcbrep)  # -> BCPoints, BCCones, ColoringForBCCones
material = CreateMaterial(EModulus="10000", PRatio="0.3")
femeshtbrep = FiniteElementOfMeshedTBrep(
    Mesh=meshcbrep,
    BoundaryConditions=unibc.BCPoints,
    PointLoads=uniloads.PointLoads,
    PreDeformations=predef_4,
    Brep=p2b,
    Material=material)  # -> Disp, Strain, Stress, N, Text, Size, Plane, Color_T, Nodes
viewdef = ViewDeformations(Mesh=meshcbrep, Displacement=femeshtbrep.Disp, Scaling=Slider(84, range=0..1000))  # -> BrepSolid, ColorSolid, BrepOuterEdges, ColorEdges, Text, Size, Plane, ColorT
panel = Panel(femeshtbrep.Disp)
