# Grasshopper definition ArchComparing.gh (Grasshopper 1.0.7)
# plug-ins: SolidsVR

pt = ConstructPoint(XCoordinate=Slider(-50, range=-50..50), YCoordinate=Slider(-50, range=-50..50), ZCoordinate=0)
pt_2 = ConstructPoint(XCoordinate=Slider(50, range=-50..50), YCoordinate=Slider(-50, range=-50..50), ZCoordinate=0)
pt_3 = ConstructPoint(XCoordinate=Slider(50, range=-50..50), YCoordinate=Slider(50, range=-50..50), ZCoordinate=0)
pt_4 = ConstructPoint(XCoordinate=Slider(-50, range=-50..50), YCoordinate=Slider(50, range=-50..50), ZCoordinate=0)
pt_5 = ConstructPoint(XCoordinate=Slider(1050, range=950..1050), YCoordinate=Slider(-50, range=-50..50), ZCoordinate=0)
pt_6 = ConstructPoint(XCoordinate=0, YCoordinate=0, ZCoordinate=0)
pt_7 = ConstructPoint(XCoordinate=Slider(950, range=950..1050), YCoordinate=Slider(50, range=-50..50), ZCoordinate=0)
pt_8 = ConstructPoint(XCoordinate=Slider(1050, range=950..1050), YCoordinate=Slider(50, range=-50..50), ZCoordinate=0)
pt_9 = ConstructPoint(XCoordinate=Slider(950, range=950..1050), YCoordinate=Slider(-50, range=-50..50), ZCoordinate=0)
pt_10 = ConstructPoint(XCoordinate=Slider(50, range=-50..50), YCoordinate=Slider(50, range=-50..50), ZCoordinate=0)
pt_11 = ConstructPoint(XCoordinate=Slider(1000, range=0..1000), YCoordinate=0, ZCoordinate=Slider(0, range=0..100))
pt_12 = ConstructPoint(XCoordinate=Slider(500, range=0..500), YCoordinate=0, ZCoordinate=Slider(500, range=0..500))
pt_13 = ConstructPoint(XCoordinate=Slider(-50, range=-50..50), YCoordinate=Slider(-50, range=-50..50), ZCoordinate=0)
pt_14 = Point([pt, pt_2, pt_3, pt_4, pt_5, pt_9, pt_7, pt_8])
arc = Arc3Pt(PointA=pt_6, PointB=pt_12, PointC=pt_11)  # -> Arc, Plane, Radius
rec_2pt = Rectangle2Pt(Plane=PlaneXY(0, 0, 0), PointA=pt_13, PointB=pt_10, Radius=0)  # -> Rectangle, Length
swp1 = Sweep1(Rail=arc.Arc, Sections=rec_2pt.Rectangle, Miter=1)
number_slider = Slider(3, range=0..10)
cap = CapHoles(Brep=swp1)
number_slider_2 = Slider(3, range=0..10)
number_slider_3 = Slider(10, range=0..100)
meshsbrep = MeshSBrep(Brep=cap, Point=pt_14, UCount=number_slider, VCount=number_slider_2, WCount=number_slider_3, VolumeToRemove=0)
meshcbrep = MeshCBrep(Brep=cap, Point=pt_14, UCount=number_slider, VCount=number_slider_2, WCount=number_slider_3, VolumeToRemove=0)
debrep = DeconstructBrep()  # -> Faces, Edges, Vertices
xy = XYPlane(Origin=Point(0, 0, 0))
vec = VectorXYZ(XComponent="500", YComponent="500", ZComponent="500")  # -> Vector, Length
Y = UnitY(Factor="-10")
sph = Sphere(Base=xy, Radius="1")
Z = UnitZ(Factor="-10")
move = Move(Geometry=sph, Motion=vec.Vector)  # -> Geometry, Transform
unibc = UniformBCComponentForFEA(SurfaceNumber=Slider(4, range=0..5), Mesh=meshcbrep)  # -> BCPoints, BCCones, ColoringForBCCones
unibc_2 = UniformBCComponentForFEA(SurfaceNumber=Slider(5, range=0..5), Mesh=meshcbrep)  # -> BCPoints, BCCones, ColoringForBCCones
panel = Panel("0,0,0")
uniloads = UniformLoadComponentForFEA(SurfaceNumber=Slider(3, range=0..5), LoadVector=Z, Mesh=meshcbrep)  # -> PointLoads, LoadArrows, ArrowColoring
Z_2 = UnitZ(Factor="0")
material = CreateMaterial(EModulus="210000", PRatio="0.3", YieldStress="255")
predef = PreDef(Sphere=move.Geometry, PrescribedDeformations=Z_2, Mesh=meshcbrep)  # -> PrescribedDeformations, Text, Plane, Colors
femeshtbrep = FiniteElementOfMeshedTBrep()  # -> Displacement, Strain, Stress, Nodes, Text, Size, Plane
femeshtbrep_2 = FiniteElementOfMeshedTBrep(
    Mesh=meshcbrep,
    BoundaryConditions=[unibc_2.BCPoints, unibc.BCPoints],
    PointLoads=uniloads.PointLoads,
    PreDeformations=predef.PrescribedDeformations,
    Material=material)  # -> Displacement, Strain, Stress, Nodes, Size, Plane, ColorT
number_slider_4 = Slider(39, range=0..100)  # disabled
viewdef = ViewDeformations(Mesh=meshcbrep, Displacement=femeshtbrep.Displacement, Scaling=number_slider_4)  # -> BrepSolid, ColorSolid, BrepOuterEdges, ColorEdges, Text, Size, Plane, ColorT; disabled
