# Grasshopper definition ArchComparing_case3.gh (Grasshopper 1.0.7)
# plug-ins: SolidsVR

pt = ConstructPoint(XCoordinate=Slider(-50, range=-50..50), YCoordinate=Slider(-50, range=-50..50), ZCoordinate=0)
pt_2 = ConstructPoint(XCoordinate=Slider(50, range=-50..50), YCoordinate=Slider(-50, range=-50..50), ZCoordinate=0)
pt_3 = ConstructPoint(XCoordinate=Slider(50, range=-50..50), YCoordinate=Slider(50, range=-50..50), ZCoordinate=0)
pt_4 = ConstructPoint(XCoordinate=Slider(-50, range=-50..50), YCoordinate=Slider(50, range=-50..50), ZCoordinate=0)
pt_5 = ConstructPoint(
    XCoordinate=Slider(1000, range=950..1000),
    YCoordinate=Slider(50, range=-50..50),
    ZCoordinate=Slider(1050, range=0..1050))
pt_6 = ConstructPoint(
    XCoordinate=Slider(1000, range=950..1000),
    YCoordinate=Slider(-50, range=-50..50),
    ZCoordinate=Slider(1050, range=0..1050))
pt_7 = ConstructPoint(
    XCoordinate=Slider(1000, range=950..1000),
    YCoordinate=Slider(-50, range=-50..50),
    ZCoordinate=Slider(950, range=0..1050))
pt_8 = ConstructPoint(XCoordinate=Slider(1000, range=950..1000), YCoordinate=Slider(50, range=-50..50), ZCoordinate=Slider(950, range=0..1050))
pt_9 = ConstructPoint(XCoordinate=0, YCoordinate=0, ZCoordinate=0)
pt_10 = ConstructPoint(XCoordinate=Slider(1000, range=0..1000), YCoordinate=0, ZCoordinate=Slider(1000, range=0..1000))
pt_11 = ConstructPoint(XCoordinate="292.9", YCoordinate=0, ZCoordinate="707.1")
pt_12 = ConstructPoint(XCoordinate=0, YCoordinate=0, ZCoordinate=0)
pt_13 = ConstructPoint(XCoordinate=Slider(50, range=-50..50), YCoordinate=Slider(50, range=-50..50), ZCoordinate=0)
pt_14 = ConstructPoint(XCoordinate=Slider(-75, range=-100..0), YCoordinate=0, ZCoordinate=0)
pt_15 = ConstructPoint(XCoordinate=Slider(-50, range=-50..50), YCoordinate=Slider(50, range=-50..50), ZCoordinate=0)
pt_16 = ConstructPoint(XCoordinate=Slider(50, range=-50..50), YCoordinate=Slider(-50, range=-50..50), ZCoordinate=0)
pt_17 = ConstructPoint(XCoordinate=Slider(-50, range=-50..50), YCoordinate=Slider(-50, range=-50..50), ZCoordinate=0)
pt_18 = Point([pt, pt_2, pt_3, pt_4, pt_6, pt_7, pt_8, pt_5])
arc = Arc3Pt(PointA=pt_9, PointB=pt_11, PointC=pt_10)  # -> Arc, Plane, Radius
ln = Line(StartPoint=pt_15, EndPoint=pt_13)
ln_2 = Line(StartPoint=pt_16, EndPoint=pt_17)
arc_2 = Arc3Pt(PointA=pt_13, PointB=pt_12, PointC=pt_16)  # -> Arc, Plane, Radius
arc_3 = Arc3Pt(PointA=pt_17, PointB=pt_14, PointC=pt_15)  # -> Arc, Plane, Radius
crv = Curve(ln_2)
crv_2 = Curve(ln)
crv_3 = Curve(arc_2.Arc)
crv_4 = Curve(arc_3.Arc)
edgesrf = EdgeSurface(CurveA=crv_2, CurveB=crv_3, CurveC=crv, CurveD=crv_4)
swp1 = Sweep1(Rail=arc.Arc, Sections=edgesrf, Miter=1)
cap = CapHoles(Brep=swp1)
number_slider = Slider(4, range=0..10)
mesh_crazy_geometry = MeshingBrep(Brep=cap, Point=pt_18, UCount=number_slider, VCount=number_slider, WCount=Slider(8, range=0..10))  # -> Mesh, Curve, Surface
deconstruct_meshcbrep = DeconstructMesh(Mesh=mesh_crazy_geometry.Mesh)  # -> ElementVertices, Connectivity, Edges, Surfaces, Points, Nodes, Elements
branch = TreeBranch(Tree=simplify(deconstruct_meshcbrep.Edges), Path=Slider(10, range=0..10), MaintainPaths=True)
