# Grasshopper definition CantileverTest.gh (Grasshopper 1.0.7)
# plug-ins: SolidsVR

pt = ConstructPoint(XCoordinate=0, YCoordinate="1000", ZCoordinate="2000")
pt_2 = ConstructPoint(XCoordinate=0, YCoordinate=0, ZCoordinate=0)
pt_3 = ConstructPoint(XCoordinate=0, YCoordinate="1000", ZCoordinate=0)
pt_4 = ConstructPoint(XCoordinate=0, YCoordinate=0, ZCoordinate="2000")
pt_5 = ConstructPoint(XCoordinate="1000", YCoordinate=0, ZCoordinate=0)
pt_6 = ConstructPoint(XCoordinate="1000", YCoordinate="1000", ZCoordinate=0)
pt_7 = ConstructPoint(XCoordinate="1000", YCoordinate="1000", ZCoordinate="2000")
pt_8 = ConstructPoint(XCoordinate="1000", YCoordinate=0, ZCoordinate="2000")
Z = UnitZ(Factor="-10")
pt_9 = Point([pt_2, pt_5, pt_6, pt_3, pt_4, pt_8, pt_7, pt])
number_slider = Slider(8, range=0..20)
p2b = PointsToBrep(Points=pt_9)
vec = VectorXYZ(XComponent="3000", YComponent="3000", ZComponent=0)  # -> Vector, Length
sph = Sphere(Base=vec.Vector, Radius="1")
meshcbrep = MeshCBrep(
    Brep=p2b,
    Point=pt_9,
    UCount=number_slider,
    VCount=number_slider,
    WCount=Slider(16, range=0..16),
    VolumeToRemove=Slider(0, range=0..30))
uniloads = UniformLoadComponentForFEA(SurfaceNumber=Slider(5, range=0..5), LoadVector=Z, Mesh=meshcbrep)  # -> PointLoads, LoadArrows, ArrowColoring
unibc = UniformBCComponentForFEA(Surface=Slider(4, range=0..5), UCount=meshcbrep)  # -> BCPoints, BCCones, ColoringForBCCones
deconstruct_meshcbrep = DeconstructMesh(Mesh=meshcbrep)  # -> ElementVertices, Connectivity, Edges, Surfaces, Points, Nodes, Elements
predef = PreDef(Sphere=sph, PrescribedDeformations=vec.Vector, Mesh=meshcbrep)  # -> PrescribedDeformations, Text, Plane, Colors, Colors_2
material = CreateMaterial(EModulus="210000", PRatio="0.3", YieldStress="3550")
number_slider_2 = Slider(4, range=0..50)
number_slider_3 = Slider(4, range=0..100)
item = ListItem(List=deconstruct_meshcbrep.Elements, Index=number_slider_2, Wrap=True)
topopt = TopOpt(
    Mesh=meshcbrep,
    BoundaryConditions=unibc.BCPoints,
    PointLoads=uniloads.PointLoads,
    PreDeformations=predef.PrescribedDeformations,
    Brep=material)  # -> Displacement, Strain, Stress, Nodes, Text, Size, Plane
viewdef = ViewDeformations(Mesh=meshcbrep, Scaling=topopt.Displacement, Scaling_2=Slider(84, range=0..1000))  # -> BrepSolid, ColorSolid, BrepOuterEdges, ColorEdges, Text, Size, Plane, ColorT
panel = Panel(topopt.Displacement)
branch = TreeBranch(Tree=simplify(deconstruct_meshcbrep.Edges), Path=number_slider_2, MaintainPaths=True)
