# Grasshopper definition TopologyCantilever_RemoveCentralElements.gh (Grasshopper 1.0.7)
# plug-ins: SolidsVR

number_slider = Slider(1000, range=0..1000)
number_slider_2 = Slider(200, range=0..200)
pt = ConstructPoint(XCoordinate=number_slider, YCoordinate=number_slider_2, ZCoordinate=0)
pt_2 = ConstructPoint(XCoordinate=0, YCoordinate=0, ZCoordinate=0)
pt_3 = ConstructPoint(XCoordinate=number_slider, YCoordinate=0, ZCoordinate=0)
pt_4 = ConstructPoint(XCoordinate=0, YCoordinate=number_slider_2, ZCoordinate=0)
pt_5 = ConstructPoint(XCoordinate=0, YCoordinate=0, ZCoordinate=number_slider_2)
pt_6 = ConstructPoint(XCoordinate=number_slider, YCoordinate=0, ZCoordinate=number_slider_2)
pt_7 = ConstructPoint(XCoordinate=number_slider, YCoordinate=number_slider_2, ZCoordinate=number_slider_2)
pt_8 = ConstructPoint(XCoordinate=0, YCoordinate=number_slider_2, ZCoordinate=number_slider_2)
pt_9 = Point([pt_2, pt_3, pt, pt_4, pt_5, pt_6, pt_7, pt_8])
p2b = PointsToBrep(Points=pt_9)
number_slider_3 = Slider(3, range=0..50)
Z = UnitZ(Factor="-10")
Z_2 = UnitZ(Factor="0")
sph = Sphere(Base=PlaneXY(0, 0, 0), Radius=1)
meshcbrep = MeshCBrep(
    Brep=p2b,
    Point=pt_9,
    UCount=Slider(10, range=0..50),
    VCount=number_slider_3,
    WCount=number_slider_3,
    RunTopOpt=Toggle(True))
uniloads = UniformLoadComponentForFEA(SurfaceNumber=Slider(5, range=0..5), LoadVector=Z, Mesh=meshcbrep)  # -> PointLoads, LoadArrows, ArrowColoring
unibc = UniformBCComponentForFEA(Surface=Slider(3, range=0..5), UCount=meshcbrep)  # -> BCPoints, BCCones, ColoringForBCCones
predef = PreDef(Sphere=sph, PrescribedDeformations=Z_2, Mesh=meshcbrep)  # -> PrescribedDeformations, Text, Plane, Colors
deconstruct_meshcbrep = DeconstructMesh(Mesh=meshcbrep)  # -> ElementVertices, Connectivity, Edges, Surfaces, Points, Nodes, Elements
number_slider_4 = Slider(1007, range=0..1600)
material = CreateMaterial(EModulus="210000", PRatio="0.3", YieldStress="250")
item = ListItem(List=deconstruct_meshcbrep.Points, Index=number_slider_4, Wrap=True)
topopt = TopOpt(
    Mesh=meshcbrep,
    BoundaryConditions=unibc.BCPoints,
    PointLoads=uniloads.PointLoads,
    PreDeformations=predef.PrescribedDeformations,
    Brep=p2b,
    Material=material)  # -> Disp, Strain, Stress, N, Text, Size, Plane, Color_T, Nodes
panel = Panel(item)
item_2 = ListItem(Index=0, Wrap=True)
viewdef = ViewDeformations(Mesh=meshcbrep, Displacement=topopt.Disp, Scaling=1)  # -> BrepSolid, ColorSolid, BrepOuterEdges, ColorEdges, Text, Size, Plane, ColorT
branch = TreeBranch(Tree=simplify(deconstruct_meshcbrep.Edges), Path=number_slider_4, MaintainPaths=True)
panel_2 = Panel(topopt.Stress)
panel_3 = Panel(topopt.Disp)
