# Grasshopper definition CurveBrep.gh (Grasshopper 1.0.7)
# plug-ins: SolidsVR

number_slider = Slider(10, range=0..10)
number_slider_2 = Slider(10, range=0..10)
number_slider_3 = Slider(10, range=0..10)
number_slider_4 = Slider(5, range=0..10)
number_slider_5 = Slider(10, range=0..10)
pt = ConstructPoint(XCoordinate=number_slider_4, YCoordinate=0, ZCoordinate=number_slider_4)
pt_2 = ConstructPoint(XCoordinate=Slider(33, range=0..110), YCoordinate=Slider(33, range=0..110), ZCoordinate=Slider(5, range=0..10))
pt_3 = ConstructPoint(XCoordinate=Slider(64, range=0..110), YCoordinate=Slider(33, range=0..110), ZCoordinate=Slider(5, range=0..10))
pt_4 = ConstructPoint(XCoordinate=Slider(105, range=0..110), YCoordinate=0, ZCoordinate=Slider(5, range=0..10))
pt_5 = ConstructPoint(XCoordinate=Slider(100, range=0..110), YCoordinate=0, ZCoordinate=Slider(10, range=0..10))
pt_6 = ConstructPoint(XCoordinate=Slider(110, range=0..110), YCoordinate=0, ZCoordinate=Slider(10, range=0..10))
pt_7 = ConstructPoint(XCoordinate=Slider(97, range=0..110), YCoordinate=0, ZCoordinate=0)
pt_8 = ConstructPoint(XCoordinate=0, YCoordinate=0, ZCoordinate=Slider(9, range=0..10))
pt_9 = ConstructPoint(XCoordinate=number_slider_5, YCoordinate=0, ZCoordinate=number_slider_5)
pt_10 = ConstructPoint(XCoordinate=0, YCoordinate=0, ZCoordinate=0)
pt_11 = ConstructPoint(XCoordinate=Slider(10, range=0..10), YCoordinate=0, ZCoordinate=0)
pt_12 = ConstructPoint(XCoordinate=Slider(110, range=0..110), YCoordinate=0, ZCoordinate=0)
pline = PolyLine(Vertices=[pt_6, pt_5, pt_7, pt_12], Closed=Toggle(True))
pline_2 = PolyLine(Vertices=[pt_8, pt_9, pt_11, pt_10], Closed=Toggle(True))
nurbs = NurbsCurve(Vertices=[pt, pt_2, pt_3, pt_4], Degree=3, Periodic=False)  # -> Curve, Length, Domain
number_slider_6 = Slider(2, range=0..10)
swp1 = Sweep1(Rail=nurbs.Curve, Sections=[pline_2, pline], Miter=1)
pt_13 = Point([pt_8, pt_9, pt_11, pt_10, pt_6, pt_5, pt_7, pt_12])
cap = CapHoles(Brep=swp1)
swp2 = Sweep2(SameHeight=False)
panel = Panel("10")
brep = Brep(cap)
meshcbrep = MeshCBrep(Brep=cap, Point=pt_13, UCount=number_slider_6, VCount=number_slider_6, WCount=number_slider_6)  # -> Connectivity, Nodes
debrep = DeconstructBrep(Brep=brep)  # -> Faces, Edges, Vertices
branch = TreeBranch(Tree=simplify(meshcbrep.Nodes), Path=Slider(7, range=0..10), MaintainPaths=True)
item = ListItem(List=debrep.Vertices, Index=Slider(4, range=0..7), Wrap=True)
item_2 = ListItem(List=debrep.Faces, Index=Slider(5, range=0..7), Wrap=True)
item_3 = ListItem(List=debrep.Edges, Index=Slider(0, range=0..12), Wrap=True)
divide = DivideCurve(Curve=debrep.Edges, Count=10, Kinks=False)  # -> Points, Tangents, Parameters
