# Grasshopper definition Sensor_case2.gh (Grasshopper 1.0.7)
# plug-ins: SolidsVR

# SECTION 1
number_slider = Slider(-50, range=-100..100)
# SECTION 2
number_slider_2 = Slider(50, range=-100..100)
number_slider_3 = Slider(-50, range=-100..100)
# RAIL
crv = Curve(<curve referenced from the Rhino model>)
end = EndPoints(Curve=crv)  # -> Start, End
vec = VectorXYZ(XComponent=number_slider, YComponent=number_slider, ZComponent=0)  # -> Vector, Length
vec_2 = VectorXYZ(XComponent=Slider(50, range=-100..100), YComponent=Slider(-50, range=-100..100), ZComponent=0)  # -> Vector, Length
vec_3 = VectorXYZ(XComponent=Slider(50, range=-100..100), YComponent=Slider(50, range=-100..100), ZComponent=0)  # -> Vector, Length
vec_4 = VectorXYZ(XComponent=Slider(-50, range=-100..100), YComponent=Slider(50, range=-100..100), ZComponent=0)  # -> Vector, Length
vec_5 = VectorXYZ(XComponent=number_slider_2, YComponent=Slider(-50, range=-100..100), ZComponent=0)  # -> Vector, Length
vec_6 = VectorXYZ(XComponent=number_slider_3, YComponent=number_slider_3, ZComponent=0)  # -> Vector, Length
vec_7 = VectorXYZ(XComponent=Slider(-50, range=-100..100), YComponent=Slider(50, range=-100..100), ZComponent=0)  # -> Vector, Length
vec_8 = VectorXYZ(XComponent=Slider(50, range=-100..100), YComponent=Slider(50, range=-100..100), ZComponent=0)  # -> Vector, Length
move = Move(Geometry=end.Start, Motion=vec.Vector)  # -> Geometry, Transform
move_2 = Move(Geometry=end.Start, Motion=vec_2.Vector)  # -> Geometry, Transform
move_3 = Move(Geometry=end.Start, Motion=vec_3.Vector)  # -> Geometry, Transform
move_4 = Move(Geometry=end.Start, Motion=vec_4.Vector)  # -> Geometry, Transform
move_5 = Move(Geometry=end.End, Motion=vec_5.Vector)  # -> Geometry, Transform
move_6 = Move(Geometry=end.End, Motion=vec_6.Vector)  # -> Geometry, Transform
move_7 = Move(Geometry=end.End, Motion=vec_7.Vector)  # -> Geometry, Transform
move_8 = Move(Geometry=end.End, Motion=vec_8.Vector)  # -> Geometry, Transform
pt = Point([move.Geometry, move_2.Geometry, move_3.Geometry, move_4.Geometry, move_5.Geometry, move_6.Geometry, move_7.Geometry, move_8.Geometry])
srf4pt = _4PointSurface(CornerA=move.Geometry, CornerB=move_2.Geometry, CornerC=move_3.Geometry, CornerD=move_4.Geometry)
srf4pt_2 = _4PointSurface(CornerA=move_5.Geometry, CornerB=move_6.Geometry, CornerC=move_7.Geometry, CornerD=move_8.Geometry)
crv_2 = Curve(<curve referenced from the Rhino model>)
crv_3 = Curve(<curve referenced from the Rhino model>)
crv_4 = Curve(<curve referenced from the Rhino model>)
crv_5 = Curve(<curve referenced from the Rhino model>)
edgesrf = EdgeSurface(CurveA=crv_2, CurveB=crv_3, CurveC=crv_4, CurveD=crv_5)
pt_2 = Point(end.Start)
area = Area(Geometry=edgesrf)  # -> Area, Centroid
subtraction = Subtraction(A=pt_2, B=area.Centroid)
pt_3 = Point(end.End)
subtraction_2 = Subtraction(A=pt_3, B=area.Centroid)
move_9 = Move(Geometry=edgesrf, Motion=subtraction_2)  # -> Geometry, Transform
move_10 = Move(Geometry=edgesrf, Motion=subtraction)  # -> Geometry, Transform
rot3d = Rotate3D(Geometry=move_9.Geometry, Angle="3*pi/2", Center=pt_3, Axis=Vector(0, 0, 1))  # -> Geometry, Transform
rot3d_2 = Rotate3D(Geometry=move_10.Geometry, Angle=1.570796327, Center=pt_2, Axis=Vector(0, 0, 1))  # -> Geometry, Transform
Y = UnitY(Factor=1)
Y_2 = UnitY(Factor=1)
rot3d_3 = Rotate3D(Geometry=rot3d.Geometry, Angle="pi/2", Center=pt_3, Axis=Y)  # -> Geometry, Transform
rot3d_4 = Rotate3D(Geometry=rot3d_2.Geometry, Angle="pi/2", Center=pt_2, Axis=Y_2)  # -> Geometry, Transform
Z = UnitZ(Factor=1)
Z_2 = UnitZ(Factor=1)
rot3d_5 = Rotate3D(Geometry=rot3d_3.Geometry, Angle="pi", Center=pt_3, Axis=Z)  # -> Geometry, Transform
rot3d_6 = Rotate3D(Geometry=rot3d_4.Geometry, Angle="pi", Center=pt_2, Axis=Z_2)  # -> Geometry, Transform
Z_3 = UnitZ(Factor=1)
rot3d_7 = Rotate3D(Geometry=rot3d_5.Geometry, Angle="pi", Center=pt_3, Axis=Z_3)  # -> Geometry, Transform
debrep = DeconstructBrep(Brep=rot3d_6.Geometry)  # -> Faces, Edges, Vertices
debrep_2 = DeconstructBrep(Brep=rot3d_7.Geometry)  # -> Faces, Edges, Vertices
pt_4 = Point(debrep_2.Vertices)
pt_5 = Point(flatten([debrep.Vertices, pt_4]))
item = ListItem(List=flatten(pt_5), Index=0, Wrap=True)  # -> Item, Item1, Item2, Item3, Item4, Item5, Item6, Item7
pt_6 = Point([item.Item3, item.Item2, item.Item1, item.Item, item.Item7, item.Item6, item.Item5, item.Item4])
item_2 = ListItem(List=pt_6, Index=Slider(8, range=0..8), Wrap=True)
crv_6 = Curve(crv)
swp1 = Sweep1(Rail=crv_6, Sections=[rot3d_6.Geometry, rot3d_7.Geometry], Miter=1)
join = BrepJoin(Breps=flatten([swp1, rot3d_6.Geometry, rot3d_7.Geometry]))  # -> Breps, Closed
swp1_2 = Sweep1(Rail=crv, Sections=[srf4pt, srf4pt_2], Miter=1)
join_2 = BrepJoin(Breps=flatten([swp1_2, srf4pt, srf4pt_2]))  # -> Breps, Closed
number_slider_4 = Slider(3, range=0..10)
meshsbrep = MeshSBrep(
    Brep=join.Breps,
    Point=pt_6,
    UCount=number_slider_4,
    VCount=number_slider_4,
    WCount=Slider(10, range=0..10),
    VolumeToRemove=Toggle(False))  # -> Mesh, Curve, Surface, Curve_2, Surfaces
deconstruct_meshcbrep = DeconstructMesh(Mesh=meshsbrep.Mesh)  # -> ElementVertices, Connectivity, Edges, Surfaces, Points, Nodes, Elements
sph = Sphere(Base=PlaneXY(0, 0, 0), Radius=1)
move_11 = Move(Geometry=sph, Motion="999,999,999")  # -> Geometry, Transform
unibc = UniformBCComponentForFEA(SurfaceNumber=Slider(4, range=0..5), Mesh=meshsbrep.Mesh)  # -> BCPoints, BCCones, ColoringForBCCones
unibc_2 = UniformBCComponentForFEA(SurfaceNumber=Slider(5, range=0..5), Mesh=meshsbrep.Mesh)  # -> BCPoints, BCCones, ColoringForBCCones
uniloads = UniformLoadComponentForFEA(SurfaceNumber=Slider(3, range=0..5), LoadVector="0,0,-10", Mesh=meshsbrep.Mesh)  # -> PointLoads, LoadArrows, ArrowColoring
predef = PreDef(Sphere=move_11.Geometry, PrescribedDeformations="0,0,0", Mesh=meshsbrep.Mesh)  # -> PrescribedDeformations, Text, Plane, Colors
material = CreateMaterial(EModulus="210000", PRatio="0.3", YieldStress="255")
topopt = TopOpt(
    Mesh=meshsbrep.Mesh,
    BoundaryConditions=[unibc.BCPoints, unibc_2.BCPoints],
    PointLoads=uniloads.PointLoads,
    PreDeformations=predef.PrescribedDeformations,
    Material=material)  # -> Disp, Strain, Stress, N, Text, Size, Plane, Color_T, Nodes
number_slider_5 = Slider(15, range=0..100)
viewstress = ViewStresses(Mesh=meshsbrep.Mesh, Stress=topopt.Stress, StressDirection=Slider(6, range=0..6), Scaling=number_slider_5)  # -> Solid, Color_solid, Legend, Color_legend, Text, Size, Plane, Color_T
viewdef = ViewDeformations(Mesh=meshsbrep.Mesh, Displacement=topopt.Disp, Scaling=number_slider_5)  # -> BrepSolid, ColorSolid, BrepOuterEdges, ColorEdges, Text, Size, Plane, ColorT
