# Grasshopper definition meshTest.gh (Grasshopper 1.0.7)
# plug-ins: SolidsVR

crv = Curve(<curve referenced from the Rhino model>)
crv_2 = Curve(<curve referenced from the Rhino model>)
crv_3 = Curve(<curve referenced from the Rhino model>)
crv_4 = Curve(<curve referenced from the Rhino model>)
crv_5 = Curve(<curve referenced from the Rhino model>)
crv_6 = Curve(<curve referenced from the Rhino model>)
crv_7 = Curve(<curve referenced from the Rhino model>)
crv_8 = Curve(<curve referenced from the Rhino model>)
pt = ConstructPoint(XCoordinate=Slider(80, range=0..80), YCoordinate=Slider(23, range=0..30), ZCoordinate=Slider(11, range=0..30))
pt_2 = ConstructPoint(XCoordinate=Slider(100, range=0..100), YCoordinate=Slider(30, range=0..30), ZCoordinate=Slider(11, range=0..30))
pt_3 = ConstructPoint(XCoordinate=Slider(100, range=0..100), YCoordinate=Slider(30, range=0..30), ZCoordinate=Slider(29, range=0..30))
pt_4 = ConstructPoint(XCoordinate=Slider(81, range=0..100), YCoordinate=Slider(23, range=0..30), ZCoordinate=Slider(29, range=0..30))
end = EndPoints()  # -> Start, End
end_2 = EndPoints(Curve=crv)  # -> Start, End
pt_5 = ConstructPoint(XCoordinate=Slider(30, range=0..30), YCoordinate=Slider(30, range=0..30), ZCoordinate=Slider(19, range=0..30))
pt_6 = ConstructPoint(XCoordinate=Slider(60, range=0..60), YCoordinate=Slider(30, range=0..30), ZCoordinate=Slider(19, range=0..30))
pline = PolyLine(Vertices=[pt_3, pt_2, pt, pt_4], Closed=Toggle(True))
crv_9 = Curve([crv, crv_4, crv_2, crv_3])
nurbs = NurbsCurve(Vertices=[end_2.Start, pt_5, pt_6, pt], Degree=3, Periodic=False)  # -> Curve, Length, Domain
edgesrf = EdgeSurface(CurveA=crv, CurveB=crv_3, CurveC=crv_2, CurveD=crv_4)
explode = Explode(Curve=pline, Recursive=True)  # -> Segments, Vertices
swp1 = Sweep1(Rail=nurbs.Curve, Sections=[edgesrf, pline], Miter=1)
item = ListItem(List=explode.Vertices, Index=Slider(0, range=0..4), Wrap=True)
cap = CapHoles(Brep=swp1)
mesh_crazy_geometry = MeshingBrep(GlazingSurface=edgesrf, UValue=Slider(4, range=0..6), VValue=Slider(4, range=0..6), VValue_2=crv_9)  # -> Points, Normals, Normals_2
pt_7 = ConstructPoint(XCoordinate=Slider(0, range=0..1), YCoordinate=Slider(0.4, range=0..1), ZCoordinate=0)
debrep = DeconstructBrep(Brep=cap)  # -> Faces, Edges, Vertices
evalsrf = EvaluateSurface(Surface=reparameterize(edgesrf), Point=pt_7)  # -> Point, Normal, UDirection, VDirection, Frame
crv_10 = Curve(debrep.Edges)
item_2 = ListItem(List=crv_10, Index=Slider(0, range=0..12), Wrap=True)
item_3 = ListItem(List=crv_10, Index=Slider(9, range=0..12), Wrap=True)  # -> Item, Item1, Item2
debrep_2 = DeconstructBrep()  # -> Faces, Edges, Vertices
crv_11 = Curve([item_3.Item, item_3.Item1, item_3.Item2, item_2])
item_4 = ListItem(List=debrep.Edges, Index=Slider(11, range=0..12), Wrap=True)
divide = DivideCurve(Curve=crv_11, Count=Slider(2, range=0..2), Kinks=False)  # -> Points, Tangents, Parameters
item_5 = ListItem(List=debrep.Faces, Index=Slider(1, range=0..5), Wrap=True)
number_slider = Slider(0, range=0..10)
number_slider_2 = Slider(0.4, range=0..1)
item_6 = ListItem(List=divide.Points, Index=Slider(1, range=0..3), Wrap=True)  # -> flatten(Item)
item_7 = ListItem(List=item_6, Index=0, Wrap=True)  # -> Item, Item1, Item2, Item3
pt_8 = ConstructPoint(XCoordinate=number_slider, YCoordinate=number_slider, ZCoordinate=0)
pt_9 = ConstructPoint(XCoordinate=number_slider_2, YCoordinate=number_slider_2, ZCoordinate=0)
srf4pt = _4PointSurface(CornerA=item_7.Item, CornerB=item_7.Item1, CornerC=item_7.Item2, CornerD=item_7.Item3)
sdivide = DivideSurface(Surface=srf4pt, UCount=10, VCount=10)  # -> Points, Normals, Parameters
debrep_3 = DeconstructBrep(Brep=item_5)  # -> Faces, Edges, Vertices
area = Area(Geometry=srf4pt)  # -> Area, Centroid
scale = Scale(Geometry=srf4pt, Center=area.Centroid, Factor=Slider(2, range=0..2))  # -> Geometry, Transform
sint = SolidIntersection(BrepsA=cap, BrepsB=scale.Geometry)
split = SplitBrep(Brep=cap, Cutter=scale.Geometry)
panel = Panel(split)
item_8 = ListItem(List=debrep_3.Edges, Index=Slider(3, range=0..4), Wrap=True)  # -> Item, Item1
item_9 = ListItem(List=split, Index=0, Wrap=True)  # -> Item, Item1
crv_12 = Curve(item_8.Item1)
crv_13 = Curve(item_8.Item)
number_slider_3 = Slider(39, range=0..50)
brep = Brep(item_9.Item1)
divide_2 = DivideCurve(Curve=crv_13, Count=10, Kinks=False)  # -> Points, Tangents, Parameters
divide_3 = DivideCurve(Curve=crv_12, Count=10, Kinks=False)  # -> Points, Tangents, Parameters
debrep_4 = DeconstructBrep(Brep=brep)  # -> Faces, Edges, Vertices
pt_10 = Point(flatten([divide_2.Points, divide_3.Points]))
pt_11 = ConstructPoint(XCoordinate=0, YCoordinate="1", ZCoordinate=0)
pt_12 = ConstructPoint(XCoordinate=0, YCoordinate=0, ZCoordinate=0)
pt_13 = ConstructPoint(XCoordinate=number_slider_3, YCoordinate="1", ZCoordinate=0)
pt_14 = ConstructPoint(XCoordinate=number_slider_3, YCoordinate=0, ZCoordinate=0)
panel_2 = Panel(debrep_4.Faces)
pt_15 = Point([pt_12, pt_11])
pt_16 = Point([pt_14, pt_13])
panel_3 = Panel(sdivide.Parameters)
flatten = FlattenTree(Tree=pt_15, Path="0")
flatten_2 = FlattenTree(Tree=pt_16, Path="1")
pt_17 = Point([flatten, flatten_2])
crvsrf = CurveOnSurface(Surface=item_5, UVCoordinates=pt_17, Closed=False)  # -> Curve, Length, Domain
panel_4 = Panel(pt_17)
panel_5 = Panel(crvsrf.Curve)
